# Grasshopper definition example.gh (Grasshopper 1.0.7)
# plug-ins: RCBldGH, LadybugGrasshopper

cluster = Cluster()

# ----
# Building Schedule
gene_pool = GenePool(
    Decimals=2,
    Maximum=23.881,
    Minimum=23.88,
    Value=[23.88013636, 23.88013636, 23.88013636, 23.88013636, 23.88013636, 23.88013636, 23.88036364, 23.8805, 23.8805, 23.8805, 23.8805, 23.8805, 23.8805, 23.8805, 23.8805, 23.8805, 23.8805, 23.8805, 23.8805, 23.8805, 23.8805, 23.8805, 23.8805, 23.8805])
gene_pool_2 = GenePool(
    Decimals=2,
    Maximum=22.221,
    Minimum=22.22,
    Value=[22.22013636, 22.22013636, 22.22013636, 22.22013636, 22.22013636, 22.22013636, 22.22036364, 22.2205, 22.2205, 22.2205, 22.2205, 22.2205, 22.2205, 22.2205, 22.2205, 22.2205, 22.2205, 22.2205, 22.2205, 22.2205, 22.2205, 22.2205, 22.2205, 22.2205])
cluster_2 = Cluster_4()  # -> panel_2, _0_0, _0_1, _0_2, _0_3, _0_4, _0_5, _0_6, _0_7
indoor_temperature_stpt_schedule = IndoorTemperatureStptSchedule(
    ScheduleName="constant_setpoint",
    WDTsetHeat=gene_pool_2,
    WETsetHeat=gene_pool_2,
    WDTsetCool=gene_pool,
    WETsetCool=gene_pool)  # -> Schedule, Text
building_use_schedule = BuildingUseSchedule(
    ScheduleName=cluster_2.panel_2,
    Occ_WD=cluster_2._0_0,
    Occ_WE=cluster_2._0_1,
    App_WD=cluster_2._0_2,
    App_WE=cluster_2._0_3,
    Light_WD=cluster_2._0_4,
    Light_WE=cluster_2._0_5,
    HVAC_WD=cluster_2._0_6,
    HVAC_WE=cluster_2._0_7)  # -> Schedule, Text
monthly_itss = MonthlyITSS(
    ScheduleName="stpt_month",
    Timespans="0 to 12",
    IndoorTemperatureSetpointSchedules=indoor_temperature_stpt_schedule.Schedule)  # -> Schedule, Text
monthly_bus = MonthlyBUS(ScheduleName="use sched", Timespans="0 to 12", BuildingUseSchedules=building_use_schedule.Schedule)  # -> Schedule, Text
schedulesetting = ScheduleSetting(MonthlyITSS=monthly_itss.Schedule, MonthlyBUS=monthly_bus.Schedule)

lighting_templates = LightingTemplates(
    LightingName="light",
    LightingLoad="2.5",
    ParasiticLightingEnergy="0",
    DaylightingFactor="1",
    LightingOccupancyFactor="1",
    LightingIlluminationControlFactor="1")  # -> LightingSetting, Text

# ----
# Building Material
number_slider = Slider(0.84, range=0..1)
number_slider_2 = Slider(1.334, range=0..10)
internalwallmaterial = InternalWallMaterial(
    Name="InternalWall",
    UValue=Slider(6, range=0..10),
    AbsorptionCoefficient=Slider(0.5, range=0..1),
    Emissivity=Slider(0.2, range=0..1))
externalwallmaterial = ExternalWallMaterial(
    Name="ExternalWall",
    UValue=Slider(0.5, range=0..1),
    AbsorptionCoefficient=number_slider,
    Emissivity=Slider(0.7, range=0..1))
roofmaterial = RoofMaterial(
    Name="Roof",
    UValue=Slider(3.086, range=0..10),
    AbsorptionCoefficient=Slider(0.7, range=0..1),
    Emissivity=Slider(0.7, range=0..1))
groundmaterial = GroundMaterial(Name="Ground", UValue=number_slider_2)
externalfloor = ExternalFloor(Name="ExternalFloor", UValue=number_slider_2)
internalfloor = InternalFloor(Name="InternalFloor", UValue=Slider(1, range=0..10))
materialsetting = MaterialSetting(
    RoofMaterial=roofmaterial,
    ExternalWallMaterial=externalwallmaterial,
    InternalWallMaterial=internalwallmaterial,
    ExternalFloorMaterial=externalfloor,
    InternalFloorMaterial=internalfloor,
    GroundMaterial=groundmaterial)

# ----
# Building Program
ventilation_type = VentilationType()
cluster_3 = Cluster_2()
zoneprogram = ZoneProgram(
    OccupancyRate="50",
    MetabolicRate="117.28",
    ApplianceIntensity="3.5",
    OutdoorAirRate="0.01",
    AirInfiltrationRate="0",
    WindowAreaOpenPercentage="0",
    AngleOfOpening="0",
    VentilationType=ventilation_type,
    DHW="100",
    NightFlushing=Slider(0, range=0..10),
    LightingTemplate=lighting_templates.LightingSetting,
    HAVCTemplate=cluster_3)

surface = Surface([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])

# ----
# Building Window
number_slider_3 = Slider(0.8, range=0..1)
windowmaterial = WindowMaterial(Name="Window", UValue=Slider(2.273, range=0..10), Emissivity=number_slider_3, SHGC=Slider(0.4, range=0..1))
window = Window(Surface=surface, Material=windowmaterial)

# ----
# Building Brep
brep = Brep([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])

# ---- group: epw weather file
file_path = FilePath("C:\Users\28030\Downloads\CHN_Shanghai.Shanghai.583670_IWEC\CHN_Shanghai.Shanghai.583670_IWEC.epw")

# ----
ground_type = GroundType()
# Building Basic Information
building_type = BuildingType()
terrain_class = TerrainClass()
# Building Energy System
panel = Panel("20.35,20.3,20.41,20.49,20.64,22.9,23.33,23.43,23.4,21.14,20.72,20.48")
basics1_1 = Basics11(
    WeatherFile=file_path,
    BuildingName="residential shanghai",
    BuildingType=building_type,
    TerrainClass=terrain_class,
    GroundType=ground_type,
    EnvelopeHeatCapacity=Slider(70000, range=0..1000000),
    EffectiveMassArea=Slider(2, range=0..10),
    GroundTemperture=panel)  # -> Basics, Text

# ----
# Material Assign Component
materialassign4_0 = MaterialAssign40(Breps=brep, Windows=window, MaterialSetting=materialsetting, Program=zoneprogram, ScheduleSetting=schedulesetting)  # -> SuperBreps, Text

pv_type = PVType()
ventilation_type_2 = VentilationType()
pump_control_type = PumpControlType()
dhw_distribution_system = DHWDistributionSystem()
orientation = Orientation()
orientation_2 = Orientation()
dhw_generation_system = DHWGenerationSystem()
energy_source_type = EnergySourceType()
energy_source_type_2 = EnergySourceType()
pv = PV(
    PVSurfaceArea=Slider(0, range=0..100),
    PVOrientation=orientation,
    PVAngle=Slider(30, range=0..100),
    PVType=pv_type,
    PVVentilationType=ventilation_type_2)  # -> PV, Text
swh = SWH(SWHArea=Slider(0, range=0..100), SWHOrientation=orientation_2, SWHAngle=Slider(15, range=0..100))  # -> SWH, Text
wind_turbine = WindTurbine(Number=Slider(0, range=0..100), Diameter=Slider(10, range=0..10), Efficiency=Slider(0.2, range=0..1))  # -> WindTurbines, Text
pump = Pump(
    HeatingUsePumpPowerPerWaterFlowRate=Slider(255487, range=0..1000000),
    CoolingUsePumpPowerPerWaterFlowRate=Slider(0, range=0..100),
    DHWUsePumpPowerPerWaterFlowRate=Slider(127739, range=0..1000000),
    DHWUsePeakFlowRate=Slider(0.000158, range=0..0.001),
    PumpControlType=pump_control_type)  # -> Pumps, Text
building_renewable_system = BuildingRenewableSystem(PVSystem=pv.PV, SolarWaterHeatingSystem=swh.SWH, WindTurbines=wind_turbine.WindTurbines)  # -> RenewableSystem, Text
energy_source = EnergySource(HeatingEnergySource=energy_source_type_2, CoolingEnergySource=energy_source_type, DHWEnergySource=energy_source_type_2)  # -> EnergySources, Text
dhw = DHW(DHWDistributionSystem=dhw_distribution_system, DHWGenerationSystem=dhw_generation_system)  # -> DHW, Text
bem_type = BEMType()

bem3_0 = BEM30(
    SuperBreps=flatten(materialassign4_0.SuperBreps),
    Basics=basics1_1.Basics,
    DHW=dhw.DHW,
    Pumps=pump.Pumps,
    EnergySources=energy_source.EnergySources,
    BEMType=bem_type,
    RenewableSystem=building_renewable_system.RenewableSystem)
lb_falsestarttoggle = LBFalseStartToggle(False)

# ----
# Simulations Start
panel_2 = Panel("shanghai")
run2_0 = Run20(BUSData=bem3_0, ProjectName=panel_2, Run=lb_falsestarttoggle)  # -> MonthlyResult, IndoorTemperature, HourlyResult, OutputInfo, OutputInfo_2

hourly_csv_reader = HourlyCSVReader(CSVFile=run2_0.HourlyResult)  # -> OutdoorTemperature, HeatTransferWindow, Heat_transfer_wall, Heat_transfer_infiltration, Heat_transfer_natural_vent, Heating_load, Cooling_load, Lighting_energy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

# ==== cluster Cluster

# ==== cluster Cluster_2
panel = Panel("""100
80
60
40
20
0""")
panel_2 = Panel("""1
1
0.99
0.98
0.98
0.96""")
panel_3 = Panel("""0.8
0.83
0.83
0.83
0.83
0.76""")
panel_4 = Panel("""100
80
60
40
20
0""")
exhaust_air_recirculation_type = ExhaustAirRecirculationType()
heat_recovery_type = HeatRecoveryType()
cop_pair_group = CopPairGroup(LoadPercentage=panel_4, RelativeEfficiency=panel_2)
cop_pair_group_2 = CopPairGroup(LoadPercentage=panel, RelativeEfficiency=panel_3)
hvac = HVAC(
    Name="PTAC",
    ReheatUsedInSummer=False,
    ReheatTemperatureDelta="0",
    ReheatUsedInWinter=False,
    HeatingNominalEfficiency="0.85",
    HeatingCOP=cop_pair_group,
    CoolingNominalCOP="3.5",
    CoolingCOP=cop_pair_group_2,
    HVACSystemType="35",
    HeatRecoveryType=heat_recovery_type,
    ExhaustAirRecirculationType=exhaust_air_recirculation_type,
    DesignHeatingSupplyAirTemperature="50",
    DesignCoolingSupplyAirTemperature="12",
    DesignHeatingHotWaterSupplyTemperature="82",
    DesignHeatingHotWaterReturnTemperature="71",
    SpecificFanPower="107.14",
    FanFlowControlFactor="1")  # -> HVAC, Text
hvac_2 = ClusterOutput(hvac.HVAC)

# ==== cluster Cluster_4
panel = Panel("""From 0 To 7: 1, 1, 0.559, 0.559, 0.1, 0.1, 1, 1, 1, 1
From 7 To 8: 0.8831, 0.8831, 0.7185, 0.7185, 0.43, 0.43, 1, 1, 1, 1	
From 8 To 9: 0.40861, 0.40861, 0.607, 0.607, 0.189, 0.189, 1, 1, 1, 1
From 9 To 16: 0.24189, 0.24189, 0.5292, 0.5292, 0.1289, 0.1289, 1, 1, 1, 1
From 16 To 17: 0.29498, 0.29498, 0.71, 0.71, 0.4812, 0.4812, 1, 1, 1, 1
From 17 To 18: 0.5531, 0.5531, 0.863, 0.863, 0.67, 0.67, 1, 1, 1, 1
From 18 To 22: 0.89693, 0.89693, 1, 1, 1, 1, 1, 1, 1, 1
From 22 To 24: 1, 1, 0.8452, 0.8452, 0.3, 0.3, 1, 1, 1, 1""")
cluster = Cluster_3(text=panel)
explode_tree = ExplodeTree(Data=cluster)  # -> Branch0, Branch1, Branch2, Branch3, Branch4, Branch5, Branch6, Branch7, Branch8, Branch9
_0_0 = ClusterOutput(explode_tree.Branch0)
_0_1 = ClusterOutput(explode_tree.Branch1)
_0_2 = ClusterOutput(explode_tree.Branch2)
_0_3 = ClusterOutput(explode_tree.Branch3)
_0_4 = ClusterOutput(explode_tree.Branch4)
_0_5 = ClusterOutput(explode_tree.Branch5)
_0_6 = ClusterOutput(explode_tree.Branch6)
_0_7 = ClusterOutput(explode_tree.Branch7)
panel_2 = ClusterOutput("use sched")

# ==== cluster Cluster_3
text = ClusterInput()
text_split = TextSplit(Text=text, Separators="\":\"")
list_item = ListItem(List=text_split, Index="1", Wrap=True)
panel = Panel(list_item)
list_item_2 = ListItem(List=text_split, Index=0, Wrap=True)
text_split_2 = TextSplit(Text=list_item, Separators=",")
text_split_3 = TextSplit(Text=list_item_2, Separators=" ")
panel_2 = Panel(text_split)
list_item_3 = ListItem(List=text_split_3, Index="1", Wrap=True)  # -> Item, Item1, Item2
flip_matrix = FlipMatrix(Data=text_split_2)  # -> flatten(Data)
panel_3 = Panel(text_split_3)
subtraction = Subtraction(A=list_item_3.Item2, B=list_item_3.Item)  # -> simplify(graft(Result))
list_length = ListLength(List=flip_matrix)
panel_4 = Panel(flip_matrix)
panel_5 = Panel(subtraction)
repeat_data = RepeatData(Data=flatten(panel_5), Length=list_length)
duplicate_data = DuplicateData(Data=graft(flip_matrix), Number=graft(repeat_data), Order=True)  # -> flatten(Data)
partition_list = PartitionList(List=duplicate_data, Size=Slider(24, range=0..100))
chunks = ClusterOutput(partition_list)
